# Dynamo graph 1_create_scheds_w_keyword.dyn (Dynamo 2.2.1.5175)

keyword = StringInput("_SY")  # graph input

# group: Make Schedules w/ "_SY" keyword
code_block = CodeBlock(keyword=keyword)
# ---------- code_block.designscript (21 lines) ----------
String.Concat(["Door",keyword]);
Category.ByName("Doors");

String.Concat(["Window",keyword]);
Category.ByName("Windows");

String.Concat(["Wall",keyword]);
Category.ByName("Walls");

String.Concat(["Floor",keyword]);
Category.ByName("Floors");

String.Concat(["Roof",keyword]);
Category.ByName("Roofs");

String.Concat(["Panel",keyword]);
Category.ByName("Curtain Panels");


String.Concat(["Space",keyword]);
Category.ByName("Spaces");
# ----------------------------------------
schedule_type = ScheduleTypes("RegularSchedule")
createSchedule = ScheduleView.CreateSchedule(category=code_block.out1, name=code_block.out0, scheduleType=schedule_type)
schedulableFields = ScheduleView.SchedulableFields(scheduleView=createSchedule)
string_from_object = FromObject(obj=schedulableFields)
code_block_2 = CodeBlock(fields=schedulableFields, strs=string_from_object)
# ---------- code_block_2.designscript (4 lines) ----------
List.FilterByBoolMask(fields,strs=="Width")["in"];
List.FilterByBoolMask(fields,strs=="Height")["in"];
List.FilterByBoolMask(fields,strs=="Family")["in"];
List.FilterByBoolMask(fields,strs=="Type")["in"];
# ----------------------------------------
list_create = List.Create(item0=code_block_2.out0, item1=code_block_2.out1, item2=code_block_2.out2, item3=code_block_2.out3)
addFields = ScheduleView.AddFields(scheduleView=createSchedule, fields=list_create)
isNotEmpty = Custom[List.IsNotEmpty](seq=addFields)  # Just the inversion of the built-in Is Empty List node.
createSchedule_2 = ScheduleView.CreateSchedule(category=code_block.out3, name=code_block.out2, scheduleType=schedule_type)
addFields_2 = ScheduleView.AddFields(scheduleView=createSchedule_2, fields=list_create)
isNotEmpty_2 = Custom[List.IsNotEmpty](seq=addFields_2)
createSchedule_3 = ScheduleView.CreateSchedule(category=code_block.out5, name=code_block.out4, scheduleType=schedule_type)
schedulableFields_2 = ScheduleView.SchedulableFields(scheduleView=createSchedule_3)
string_from_object_2 = FromObject(obj=schedulableFields_2)
code_block_3 = CodeBlock(fields=schedulableFields_2, strs=string_from_object_2)
# ---------- code_block_3.designscript (4 lines) ----------
List.FilterByBoolMask(fields,strs=="Area")["in"];
List.FilterByBoolMask(fields,strs=="Family")["in"];
List.FilterByBoolMask(fields,strs=="Type")["in"];
List.FilterByBoolMask(fields,strs=="Function")["in"];
# ----------------------------------------
list_create_2 = List.Create(item0=code_block_3.out0, item1=code_block_3.out1, item2=code_block_3.out2, item3=code_block_3.out3)
addFields_3 = ScheduleView.AddFields(scheduleView=createSchedule_3, fields=list_create_2)
isNotEmpty_3 = Custom[List.IsNotEmpty](seq=addFields_3)
createSchedule_4 = ScheduleView.CreateSchedule(category=code_block.out7, name=code_block.out6, scheduleType=schedule_type)
createSchedule_5 = ScheduleView.CreateSchedule(category=code_block.out9, name=code_block.out8, scheduleType=schedule_type)
createSchedule_6 = ScheduleView.CreateSchedule(category=code_block.out11, name=code_block.out10, scheduleType=schedule_type)
schedulableFields_3 = ScheduleView.SchedulableFields(scheduleView=createSchedule_6)
string_from_object_3 = FromObject(obj=schedulableFields_3)
code_block_4 = CodeBlock(fields=schedulableFields_3, strs=string_from_object_3)
# ---------- code_block_4.designscript (4 lines) ----------
List.FilterByBoolMask(fields,strs=="Height")["in"];
List.FilterByBoolMask(fields,strs=="Width")["in"];
List.FilterByBoolMask(fields,strs=="Family")["in"];
List.FilterByBoolMask(fields,strs=="Type")["in"];
# ----------------------------------------
list_create_3 = List.Create(item0=code_block_4.out0, item1=code_block_4.out1, item2=code_block_4.out2)
addFields_4 = ScheduleView.AddFields(scheduleView=createSchedule_6, fields=list_create_3)
isNotEmpty_4 = Custom[List.IsNotEmpty](seq=addFields_4)
createSchedule_7 = ScheduleView.CreateSchedule(category=code_block.out13, name=code_block.out12, scheduleType=schedule_type)
schedulableFields_4 = ScheduleView.SchedulableFields(scheduleView=createSchedule_7)
string_from_object_4 = FromObject(obj=schedulableFields_4)
code_block_5 = CodeBlock(fields=schedulableFields_4, strs=string_from_object_4)
# ---------- code_block_5.designscript (16 lines) ----------
List.FilterByBoolMask(fields,strs=="Area")["in"];
List.FilterByBoolMask(fields,strs=="Name")["in"];
List.FilterByBoolMask(fields,strs=="Number")["in"];
List.FilterByBoolMask(fields,strs=="Volume")["in"];
List.FilterByBoolMask(fields,strs=="Space Type")["in"];
List.FilterByBoolMask(fields,strs=="Area per Person")["in"];
List.FilterByBoolMask(fields,strs=="Total Heat Gain per person")["in"];
List.FilterByBoolMask(fields,strs=="Sensible Heat Gain per person")["in"];
List.FilterByBoolMask(fields,strs=="Latent Heat Gain per person")["in"];
List.FilterByBoolMask(fields,strs=="Power Load Units")["in"];
List.FilterByBoolMask(fields,strs=="Specified Power Load per area")["in"];
List.FilterByBoolMask(fields,strs=="Specified Lighting Load per area")["in"];
List.FilterByBoolMask(fields,strs=="Lighting Load Units")["in"];
List.FilterByBoolMask(fields,strs=="Outdoor Air Method")["in"];
List.FilterByBoolMask(fields,strs=="Outdoor Air per Area")["in"];
List.FilterByBoolMask(fields,strs=="Outdoor Air per Person")["in"];
# ----------------------------------------
list_create_4 = List.Create(item0=code_block_5.out0, item1=code_block_5.out1, item2=code_block_5.out2, item3=code_block_5.out3, item4=code_block_5.out4, item5=code_block_5.out5, item6=code_block_5.out6, item7=code_block_5.out7, item8=code_block_5.out8, item9=code_block_5.out9, item10=code_block_5.out10, item11=code_block_5.out11, item12=code_block_5.out12, item13=code_block_5.out13, item14=code_block_5.out14, item15=code_block_5.out15)
addFields_5 = ScheduleView.AddFields(scheduleView=createSchedule_7, fields=list_create_4)
isNotEmpty_5 = Custom[List.IsNotEmpty](seq=addFields_5)

schedulableFields_5 = ScheduleView.SchedulableFields(scheduleView=createSchedule_4)
string_from_object_5 = FromObject(obj=schedulableFields_5)
code_block_6 = CodeBlock(fields=schedulableFields_5, strs=string_from_object_5)
# ---------- code_block_6.designscript (3 lines) ----------
List.FilterByBoolMask(fields,strs=="Area")["in"];
List.FilterByBoolMask(fields,strs=="Family")["in"];
List.FilterByBoolMask(fields,strs=="Type")["in"];
# ----------------------------------------
list_create_5 = List.Create(item0=code_block_6.out0, item1=code_block_6.out1, item2=code_block_6.out2)

# group (continued): Make Schedules w/ "_SY" keyword
addFields_6 = ScheduleView.AddFields(scheduleView=createSchedule_4, fields=list_create_5)
isNotEmpty_6 = Custom[List.IsNotEmpty](seq=addFields_6)

schedulableFields_6 = ScheduleView.SchedulableFields(scheduleView=createSchedule_5)
string_from_object_6 = FromObject(obj=schedulableFields_6)
code_block_7 = CodeBlock(fields=schedulableFields_6, strs=string_from_object_6)  # same code as code_block_6
list_create_6 = List.Create(item0=code_block_7.out0, item1=code_block_7.out1, item2=code_block_7.out2)

# group (continued): Make Schedules w/ "_SY" keyword
addFields_7 = ScheduleView.AddFields(scheduleView=createSchedule_5, fields=list_create_6)
isNotEmpty_7 = Custom[List.IsNotEmpty](seq=addFields_7)
list_create_7 = List.Create(item0=isNotEmpty, item1=isNotEmpty_2, item2=isNotEmpty_3, item3=isNotEmpty_6, item4=isNotEmpty_7, item5=isNotEmpty_4, item6=isNotEmpty_5)
allTrue = List.AllTrue(list=list_create_7)

watch = Watch(allTrue)
code_block_8 = CodeBlock { true; }
change_project_unit_to_m_with = Python(IN[0]=code_block_8)  # "Change Project Unit to [m] with two decimal places"
# ---------- change_project_unit_to_m_with.python (27 lines) ----------
import clr

clr.AddReference('RevitAPI')
from Autodesk.Revit.DB import *

clr.AddReference('RevitServices')
import RevitServices
from RevitServices.Persistence import DocumentManager
from RevitServices.Transactions import TransactionManager

doc = DocumentManager.Instance.CurrentDBDocument

if IN[0]:
	TransactionManager.Instance.EnsureInTransaction(doc)
	unit = doc.GetUnits()
	Len_format = FormatOptions(DisplayUnitType.DUT_METERS, 0.01)
	Area_format = FormatOptions(DisplayUnitType.DUT_SQUARE_METERS, 0.01)
	Vol_format = FormatOptions(DisplayUnitType.DUT_CUBIC_METERS, 0.01)
	unit.SetFormatOptions(UnitType.UT_Length,Len_format)
	unit.SetFormatOptions(UnitType.UT_Area,Area_format)
	unit.SetFormatOptions(UnitType.UT_Volume,Vol_format)
	
	doc.SetUnits(unit)
	TransactionManager.Instance.TransactionTaskDone()
	OUT = "length unit changed to meter"
else:
	OUT = "Set IN[0] to true!"
# ----------------------------------------
