# Dynamo graph 0_purge_scheds_w_keyword.dyn (Dynamo 2.2.1.5175)

keyword = StringInput("_SY")  # graph input

# group: Purge Schedule Views w/ "_SY" keyword
element_types = ElementTypes("ViewSchedule")
all_elements_of_type = ElementsOfType(element_type=element_types)
code_block = CodeBlock(views=all_elements_of_type, keyword=keyword) { mask=String.Contains(views.Name, keyword, false); List.FilterByBoolMask(views,mask)["in"]; }
watch = Watch(code_block.out1)

delete_schedules = Python(IN[0]=code_block.out1)
# ---------- delete_schedules.python (24 lines) ----------
# Load the Python Standard and DesignScript Libraries
import clr

clr.AddReference("RevitServices")
import RevitServices
from RevitServices.Persistence import DocumentManager
from RevitServices.Transactions import TransactionManager

doc = DocumentManager.Instance.CurrentDBDocument

elems = UnwrapElement(IN[0])
num = len(elems)

TransactionManager.Instance.EnsureInTransaction(doc)

if len(elems)==0:
	OUT = "No Elements fed in"

else:
	for e in elems:
		doc.Delete(e.Id)
    	OUT = str(num) + " Elements Deleted"
    	
TransactionManager.Instance.TransactionTaskDone()
# ----------------------------------------

# group (continued): Purge Schedule Views w/ "_SY" keyword
watch_2 = Watch(delete_schedules)
