# Dynamo graph 2_export_scheds_to_excel.dyn (Dynamo 2.2.1.5175)

keyword = StringInput("_SY")  # graph input

# group: Export Schedules w/ "_SY" keyword
element_types = ElementTypes("ViewSchedule")
all_elements_of_type = ElementsOfType(element_type=element_types)
code_block = CodeBlock(views=all_elements_of_type, keyword=keyword)
# ---------- code_block.designscript (6 lines) ----------
//ind1=List.AllIndicesOf(String.Contains(views.Name, "Analytical Spaces", false),true);
//ind2=List.AllIndicesOf(String.Contains(views.Name, "Analytical Surfaces", false),true);
ind3=List.AllIndicesOf(String.Contains(views.Name, keyword, false),true);

//inds = List.Join([ind1, ind2, ind3]);
List.GetItemAtIndex(views, ind3);
# ----------------------------------------
code_block_2 = CodeBlock(sched=code_block.out1) { ScheduleView.Name(sched); }
watch = Watch(code_block_2)
watch_2 = Watch(code_block.ind3)
excel_path = StringInput("C:\Users\temp\Documents\Carleton_GradStudies\Thesis\Scripts\excel_exports\Geo_data.xlsx")  # graph input
getData = Revit.Schedule.GetData(scheduleView=code_block.out1)
code_block_3 = CodeBlock(path=excel_path, sheet=code_block_2, data=getData) { DSOffice.Data.ExportExcel(path, sheet, 0, 0, data, true); }
watch_3 = Watch(code_block_3)

code_block_4 = CodeBlock { true; }
change_project_unit_to_m_with = Python(IN[0]=code_block_4)  # "Change Project Unit to [m] with two decimal places"
# ---------- change_project_unit_to_m_with.python (27 lines) ----------
import clr

clr.AddReference('RevitAPI')
from Autodesk.Revit.DB import *

clr.AddReference('RevitServices')
import RevitServices
from RevitServices.Persistence import DocumentManager
from RevitServices.Transactions import TransactionManager

doc = DocumentManager.Instance.CurrentDBDocument

if IN[0]:
	TransactionManager.Instance.EnsureInTransaction(doc)
	unit = doc.GetUnits()
	Len_format = FormatOptions(DisplayUnitType.DUT_METERS, 0.01)
	Area_format = FormatOptions(DisplayUnitType.DUT_SQUARE_METERS, 0.01)
	Vol_format = FormatOptions(DisplayUnitType.DUT_CUBIC_METERS, 0.01)
	unit.SetFormatOptions(UnitType.UT_Length,Len_format)
	unit.SetFormatOptions(UnitType.UT_Area,Area_format)
	unit.SetFormatOptions(UnitType.UT_Volume,Vol_format)
	
	doc.SetUnits(unit)
	TransactionManager.Instance.TransactionTaskDone()
	OUT = "length unit changed to meter"
else:
	OUT = "Set IN[0] to true!"
# ----------------------------------------
